# Grasshopper definition RhinoLayer.gh (Grasshopper 1.0.7)

# レイヤーを取得
# レイヤーを新規作成
panel = Panel("My New Layer")
# オブジェクトのレイヤーを変更
panel_2 = Panel("My New Layer")
# マテリアルをレイヤーに設定
panel_3 = Panel("My New Layer")
# メッシュをサーフェスから生成
panel_4 = Panel("My New Layer")
# レイヤーのメッシュを結合
panel_5 = Panel("My New Layer")
# レイヤーのメッシュをFBXとして書き出し
panel_6 = Panel("My New Layer")
# レイヤーに属するオブジェクトを取得
panel_7 = Panel("My New Layer")
create_layer = CSharpScript(LayerName=panel_7, TooltipDescriptionOverride="a", TooltipTextOverride="a")  # -> out, LayerObjects; inputs LayerName: String
# ---------- create_layer: C# ----------
    var layer = RhinoDocument.Layers.FindName(LayerName);
    LayerObjects = RhinoDocument.Objects.FindByLayer(layer);
# ---------- end create_layer ----------
create_layer_2 = CSharpScript(LayerName=panel_5, TooltipDescriptionOverride="a", TooltipTextOverride="a")  # -> objs; inputs LayerName: String
# ---------- create_layer_2: C# usings ----------
using System.Linq;
# ---------- create_layer_2: C# ----------
    var layer = RhinoDocument.Layers.FindName(LayerName);

    //meshであり、対象レイヤーに属するオブジェクト
    Rhino.DocObjects.ObjectEnumeratorSettings filter = new Rhino.DocObjects.ObjectEnumeratorSettings();
    filter.LayerIndexFilter = layer.Index;
    filter.ObjectTypeFilter = Rhino.DocObjects.ObjectType.Mesh;

    //RhinoObject[]からMesh[]にしたい
    var rObjs = RhinoDocument.Objects.FindByFilter(filter);
    var meshes = rObjs.Select(r => r.Geometry).Cast<Mesh>();

    //メッシュ結合
    Mesh mesh = new Mesh();
    mesh.Append(meshes);

    //RhinoDocに追加
    var attr = new Rhino.DocObjects.ObjectAttributes();
    attr.LayerIndex = layer.Index;
    RhinoDocument.Objects.AddMesh(mesh, attr);


    //元のオブジェクトを消去
    foreach(var obj in rObjs)
    {
      RhinoDocument.Objects.Delete(obj);
    }
# ---------- end create_layer_2 ----------
create_layer_3 = CSharpScript(LayerName=panel_4, TooltipDescriptionOverride="a", TooltipTextOverride="a")  # inputs LayerName: String
# ---------- create_layer_3: C# ----------
    var layer = RhinoDocument.Layers.FindName(LayerName);
    var objs = RhinoDocument.Objects.FindByLayer(layer);

    foreach(var obj in objs)
    {
      //今回はサーフェスだけ
      Surface surf = obj.Geometry as Surface;
      if(surf != null)
      {
        var attr = new Rhino.DocObjects.ObjectAttributes();
        attr.LayerIndex = layer.Index;
        Mesh mesh = Mesh.CreateFromSurface(surf);
        RhinoDocument.Objects.AddMesh(mesh, attr);

      }
    }
# ---------- end create_layer_3 ----------
create_layer_4 = CSharpScript(LayerName=panel_6, TooltipDescriptionOverride="a", TooltipTextOverride="a")  # inputs LayerName: String; disabled
# ---------- create_layer_4: C# ----------
    var layer = RhinoDocument.Layers.FindName(LayerName);

    //meshであり、対象レイヤーに属するオブジェクト
    Rhino.DocObjects.ObjectEnumeratorSettings filter = new Rhino.DocObjects.ObjectEnumeratorSettings();
    filter.LayerIndexFilter = layer.Index;
    filter.ObjectTypeFilter = Rhino.DocObjects.ObjectType.Mesh;

    //RhinoObject[]からguid[]にしたい
    var rObjs = RhinoDocument.Objects.FindByFilter(filter);
    var guids = rObjs.Select(r => r.Id);

    //メッシュだけを選択
    RhinoDocument.Objects.UnselectAll();
    RhinoDocument.Objects.Select(guids);

    //選択オブジェクトをFBXに書き出し
    Rhino.FileIO.FileWriteOptions opt = new Rhino.FileIO.FileWriteOptions();
    opt.WriteSelectedObjectsOnly = true; //選択オブジェクトだけ
    opt.WriteGeometryOnly = true; //ライト、カメラ含めない

    RhinoDocument.WriteFile(@"C:\work\RhinoLayer\Export.fbx", opt);
# ---------- end create_layer_4 ----------
create_layer_5 = CSharpScript(LayerName=panel, TooltipDescriptionOverride="a", TooltipTextOverride="a")  # inputs LayerName: String
# ---------- create_layer_5: C# ----------
    Rhino.DocObjects.Layer layer = new Rhino.DocObjects.Layer();
    layer.Name = LayerName;
    layer.Color = System.Drawing.Color.SeaGreen;
    RhinoDocument.Layers.Add(layer);
# ---------- end create_layer_5 ----------
create_layer_6 = CSharpScript(LayerName=panel_3, TooltipDescriptionOverride="a", TooltipTextOverride="a")  # inputs LayerName: String
# ---------- create_layer_6: C# ----------
    //ライノファイルにマテリアルを追加
    var index = RhinoDocument.Materials.Add();
    
   //追加したマテリアルの名称を変更
    var mat = RhinoDocument.Materials[index];
    mat.Name = LayerName;
    mat.CommitChanges();

    //レイヤーにマテリアルを設定
    var layer = RhinoDocument.Layers.FindName(LayerName);
    layer.RenderMaterialIndex = index;
# ---------- end create_layer_6 ----------
create_layer_7 = CSharpScript(FromName="To Layer", ToName=panel_2, TooltipDescriptionOverride="a", TooltipTextOverride="a")  # inputs FromName: String, ToName: String; disabled
# ---------- create_layer_7: C# ----------
    var fromL = RhinoDocument.Layers.FindName(FromName);
    var toL = RhinoDocument.Layers.FindName(ToName);
    
    Rhino.DocObjects.RhinoObject[] objs = RhinoDocument.Objects.FindByLayer(fromL);
    
    foreach(var obj in objs)
    {
      obj.Attributes.LayerIndex = toL.Index;
      obj.CommitChanges();
    }
# ---------- end create_layer_7 ----------
c_script = CSharpScript()  # -> out, Layers
# ---------- c_script: C# ----------
    Layers = RhinoDocument.Layers;
# ---------- end c_script ----------
c_script_2 = CSharpScript()  # -> out, Type
# ---------- c_script_2: C# ----------
    Type = RhinoDocument.Layers.GetType();
# ---------- end c_script_2 ----------
panel_8 = Panel(create_layer.LayerObjects)
panel_9 = Panel(c_script_2.Type)
panel_10 = Panel(c_script.Layers)
